% Simulink data dictionary data.sldd

servoPins = struct(
  aileron=struct(left=9, right=10),
  elevator=struct(left=7, right=8),
  rudder=11,
  flap=struct(left=5, right=6))

envConsts = struct(magVar=-1.3, refHeight=0)
SimType = 0

Uplink = Simulink.Bus()
  AutoflightRefValues: Bus: AutoflightDemandedValues
  Override: boolean
  ControlOverride: Bus: ControlOverrides

Errors = Simulink.Bus()
  PRESS_OOB_ERROR: boolean
  TEMP_OOB_ERROR: boolean
  AIRFRAME_G_LIMIT_EXCEEDED: boolean

FlightMode = Simulink.Bus()
  AltHold: int8
  HdgHold: int8

Demands = Simulink.Bus()
  FlightMode: Bus: FlightMode
  Altitude: single, Unit="m"
  Heading: single, Unit="deg"
  Override: boolean
  ControlOverrides: Bus: ControlOverrides

AutoflightDemandedValues = Simulink.Bus()
  FlightMode: Bus: FlightMode
  HoldAltitude: single, Unit="m"
  HoldHeading: single, Unit="deg"

ActuatorStates = Simulink.Bus()
  Aileron: double, Unit="deg"
  Elevator: double, Unit="deg"
  Rudder: double, Unit="deg"
  Flap: double, Unit="deg"

ControlOverrides = Simulink.Bus()
  Aileron: single
  Elevator: single
  Flap: single
  Throttle: single
  Rudder: single

Commands = Simulink.Bus()
  Aileron: single, Unit="deg"
  Elevator: single, Unit="deg"
  Flap: single, Unit="deg"
  Throttle: single
  Rudder: single, Unit="deg"

actuatorCentres = struct(
  aileron=struct(left=single(0), right=single(0)),
  elevator=struct(right=single(0), left=single(0)),
  flap=struct(left=single(0), right=single(0)),
  rudder=single(0))

deflectionLimits = struct(
  aileron=struct(min=single(-10), max=single(10)),
  elevator=struct(max=single(10), min=single(-10)),
  flap=struct(max=single(15), min=single(0)),
  rudder=struct(min=single(-5), max=single(5)))

vehicle = struct(
  mass=1.5,
  inertia=[1 0 0; 0 1 0; 0 0 1],
  wingspan=1.8,
  wingarea=0.45,
  aclength=0.8,
  CG=[0.4 0 0],
  CP=[0.01 0 -0.001],
  stallSpeed=10,
  thrust=7.5619,
  cbar=0.25)

States = Simulink.Bus()
  phi_theta_psi: double[3], Unit="rad"
  pqr: double[3], Unit="rad/s"
  omega_dot: single, Unit="rad/s^2"
  X_e: double[3], Unit="m"
  V_b: double[3], Unit="m/s"
  A_be: double[3], Unit="m/s^2"

Sensors = Simulink.Bus()
  Pressure: single, Unit="Pa"
  Temperature: single, Unit="°C"
  pqr: single[3], Unit="rad/s"
  phi_theta_psi: single[3], Unit="rad"
  A_be: single[3], Unit="m/s^2"
  V_b: single[3], Unit="m/s"
  X_e: single[3], Unit="m"
  Heading: single, Unit="deg"
  Altitude: single, Unit="m"

sensorSampleTime = Simulink.Parameter(0.02)
initConditions = struct(x0=[0 0 50], v0=[40 0 0], euler0=[0 0 0], w0=[0 0 0])

datcom1 = {struct(
  case="FLAPS: UAV",
  mach=[0.03 0.1],
  alt=[50 100 300],
  alpha=[-16 -8 -6 -4 -2 0 2 4 8 9 10 12 14 16 18 19 20 21 22 24],
  nmach=2,
  nalt=3,
  nalpha=20,
  rnnub=[],
  hypers=false,
  loop=2,
  sref=6.79,
  cbar=1.15,
  blref=5.9,
  dim="ft",
  deriv="deg",
  stmach=0.6,
  tsmach=1.4,
  save=false,
  stype=[],
  trim=false,
  damp=true,
  build=1,
  part=true,
  highsym=true,
  highasy=false,
  highcon=false,
  tjet=false,
  hypeff=false,
  lb=false,
  pwr=false,
  grnd=false,
  wsspn=2.79,
  hsspn=1,
  ndelta=5,
  delta=[0 5 10 15 20],
  deltal=[],
  deltar=[],
  ngh=0,
  grndht=[],
  config=struct(downwash=false, body=true, wing=true, htail=false, vtail=false, vfin=false),
  version=1976,
  cd=reshape([0.051 0.017 0.014 0.013 0.014 0.016 0.021 0.028 0.05 0.057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], 20, 2, 3),
  cl=reshape([-0.779 -0.254 -0.131 -0.015 0.101 0.223 0.352 0.486 0.765 0.835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], 20, 2, 3),
  cm=reshape([-0.1759 -0.0809 -0.0606 -0.0418 -0.0238 -0.0053 0.0135 0.0326 0.0709 0.0805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], 20, 2, 3),
  cn=reshape([-0.763 -0.254 -0.132 -0.016 0.1 0.223 0.353 0.487 0.764 0.834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], 20, 2, 3),
  ca=reshape([-0.165 -0.018 0.001 0.012 0.017 0.016 0.009 -0.006 -0.057 -0.074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], 20, 2, 3),
  xcp=reshape([0.231 0.319 0.459 2.692 -0.238 -0.024 0.038 0.067 0.093 0.096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], 20, 2, 3),
  cma=reshape([0.01323 0.01051 0.00978 0.009201 0.009122 0.009326 0.009475 0.009553 0.009567 0.009541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], 20, 2, 3),
  cyb=reshape([0 99999 99999 99999 99999 99999 99999 99999 99999 99999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], 20, 2, 3),
  cnb=reshape([-Inf 99999 99999 99999 99999 99999 99999 99999 99999 99999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], 20, 2, 3),
  clb=reshape([0.0007507 0.0001354 -8.121e-6 -0.0001448 -0.00028 -0.0004236 -0.0005746 -0.0007315 -0.001058 -0.001141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], 20, 2, 3),
  cla=reshape([0.06916 0.06213 0.05978 0.05802 0.05951 0.06285 0.06569 0.06785 0.07065 0.07101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], 20, 2, 3),
  clq=reshape([0.004413 99999 99999 99999 99999 99999 99999 99999 99999 99999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], 20, 2, 3),
  cmq=reshape([-0.002706 99999 99999 99999 99999 99999 99999 99999 99999 99999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], 20, 2, 3),
  clad=reshape([NaN 99999 99999 99999 99999 99999 99999 99999 99999 99999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], 20, 2, 3),
  cmad=reshape([NaN 99999 99999 99999 99999 99999 99999 99999 99999 99999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], 20, 2, 3),
  clp=reshape([-7.375e-5 -3.182e-5 -2.805e-5 -2.663e-5 -2.749e-5 -3.076e-5 -3.662e-5 -4.535e-5 -7.216e-5 -8.086e-5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], 20, 2, 3),
  cyp=reshape([-0.0008371 -0.0002744 -0.0001426 -1.6e-5 0.0001109 0.0002482 0.0003968 0.0005587 0.0009476 0.001072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], 20, 2, 3),
  cnp=reshape([0.001284 0.000421 0.0002188 2.455e-5 -0.0001702 -0.0003808 -0.0006087 -0.0008568 -0.001452 -0.001643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], 20, 2, 3),
  cnr=reshape([-0.0003189 -8.144e-5 -6.078e-5 -5.333e-5 -5.768e-5 -7.508e-5 -0.0001076 -0.0001567 -0.0003092 -0.0003589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], 20, 2, 3),
  clr=reshape([-0.003348 -0.001091 -0.0005643 -6.297e-5 0.0004333 0.0009603 0.001514 0.00209 0.003287 0.003592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], 20, 2, 3),
  wetarea_b=repmat(1.921, 2, 3),
  xcg_b=repmat(1.22, 2, 3),
  zcg_b=repmat(0.11, 2, 3),
  basearea_b=repmat(0.033, 2, 3),
  cd0_b=[0.001695 0.001696 0.001697; 0.001443 0.001443 0.001444],
  basedrag_b=[0.0002593 0.0002592 0.0002591; 0.0002893 0.0002893 0.0002892],
  fricdrag_b=[0.001436 0.001437 0.001438; 0.001153 0.001154 0.001155],
  presdrag_b=repmat(NaN, 2, 3),
  lemac=repmat(0.37, 2, 3),
  area_w_tt=repmat(4.839, 2, 3),
  taperratio_w_tt=repmat(1, 2, 3),
  aspectratio_w_tt=repmat(7.193, 2, 3),
  qcsweep_w_tt=repmat(0, 2, 3),
  mac_w_tt=repmat(0.82, 2, 3),
  qcmac_w_tt=repmat(1.06, 2, 3),
  ymac_w_tt=repmat(1.48, 2, 3),
  cd0_w_tt=repmat(99999, 2, 3),
  friccoeff_w_tt=repmat(99999, 2, 3),
  area_w_te=repmat(4.577, 2, 3),
  taperratio_w_te=repmat(1, 2, 3),
  aspectratio_w_te=repmat(6.803, 2, 3),
  qcsweep_w_te=repmat(0, 2, 3),
  mac_w_te=repmat(0.82, 2, 3),
  qcmac_w_te=repmat(1.06, 2, 3),
  ymac_w_te=repmat(1.56, 2, 3),
  cd0_w_te=[0.0104 0.0104 0.0104; 0.00826 0.00826 0.00827],
  friccoeff_w_te=[0.0062 0.0062 0.0062; 0.00492 0.00492 0.00492],
  cla_b_w=[0.003566 0.003566 0.003566; 0.003573 0.003573 0.003573],
  cla_w_b=[0.05277 0.05277 0.05277; 0.05288 0.05288 0.05288],
  k_b_w=repmat(0.07051, 2, 3),
  k_w_b=repmat(1.043, 2, 3),
  xacc_b_w=repmat(0.1783, 2, 3),
  hiv_b_w=repmat(99999, 20, 2, 3),
  hiv_w_h=repmat(99999, 20, 2, 3),
  hiv_b_h=repmat(99999, 20, 2, 3),
  gamma=reshape([NaN NaN NaN 0 0 0 0 0 NaN NaN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], 20, 2, 3),
  gamma2pialpvr=repmat(NaN, 20, 2, 3),
  iv_b_w=repmat(0, 20, 2, 3),
  iv_w_h=repmat(NaN, 20, 2, 3),
  iv_b_h=repmat(NaN, 20, 2, 3),
  clpgammacl0=[-0.46082 -0.46082 -0.46082; -0.46153 -0.46153 -0.46153],
  clpgammaclp=repmat(1, 2, 3),
  cnptheta=repmat(-0.00027961, 2, 3),
  cypgamma=repmat(0, 2, 3),
  cypcl=[0.069765 0.069765 0.069765; 0.06969 0.06969 0.06969],
  clbgamma=repmat(-0.0002375, 2, 3),
  cmothetaw=repmat(NaN, 2, 3),
  cmothetah=repmat(NaN, 2, 3),
  dcl_sym=reshape([0 0.127 0.254 0.366 0.393 0 0.133 0.267 0.384 0.413 0 0.127 0.254 0.366 0.393 0 0.133 0.267 0.384 0.413 0 0.127 0.254 0.366 0.393 0 0.133 0.267 0.384 0.413], 5, 2, 3),
  dcm_sym=reshape([0 0.0016 0.0032 0.0053 -0.0041 0 0.0021 0.0042 0.0067 -0.0029 0 0.001 0.0021 0.0036 -0.0062 0 0.0013 0.0026 0.0044 -0.0054 0 -0.0004 -0.0008 -0.0005 -0.0107 0 0.0031 0.0063 0.0095 0.0024], 5, 2, 3),
  dclmax_sym=reshape([0 0.069 0.134 0.187 0.232 0 0.069 0.134 0.187 0.232 0 0.069 0.134 0.187 0.232 0 0.069 0.134 0.187 0.232 0 0.069 0.134 0.187 0.232 0 0.069 0.134 0.187 0.232], 5, 2, 3),
  dcdmin_sym=reshape([1.0e-5 0.00414 0.00937 0.019 0.02706 1.0e-5 0.00419 0.0096 0.01948 0.02761 1.0e-5 0.00414 0.00937 0.01901 0.02706 1.0e-5 0.00419 0.0096 0.01948 0.02761 1.0e-5 0.00414 0.00938 0.01901 0.02707 1.0e-5 0.00419 0.0096 0.01948 0.02761], 5, 2, 3),
  clad_sym=repmat(NaN, 5, 2, 3),
  cha_sym=reshape([-0.008628 99999 99999 99999 99999 -0.008625 99999 99999 99999 99999 -0.008629 99999 99999 99999 99999 -0.008626 99999 99999 99999 99999 -0.008632 99999 99999 99999 99999 -0.008626 99999 99999 99999 99999], 5, 2, 3),
  chd_sym=reshape([-0.01594 -0.01594 -0.01594 -0.01602 -0.01638 -0.0155 -0.0155 -0.0155 -0.01558 -0.01596 -0.01594 -0.01594 -0.01594 -0.01602 -0.01638 -0.0155 -0.0155 -0.0155 -0.01558 -0.01596 -0.01594 -0.01594 -0.01594 -0.01602 -0.01638 -0.0155 -0.0155 -0.0155 -0.01558 -0.01596], 5, 2, 3),
  dcdi_sym=reshape([-2.07e-5 -7.18e-6 -3.8e-6 -4.33e-7 2.94e-6 6.31e-6 9.68e-6 1.31e-5 1.98e-5 2.15e-5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], 20, 5, 2, 3)), struct(
  case="AILERONS: UAV",
  mach=[0.03 0.1],
  alt=[50 100 300],
  alpha=[-16 -8 -6 -4 -2 0 2 4 8 9 10 12 14 16 18 19 20 21 22 24],
  nmach=2,
  nalt=3,
  nalpha=20,
  rnnub=[],
  hypers=false,
  loop=2,
  sref=6.79,
  cbar=1.15,
  blref=5.9,
  dim="ft",
  deriv="deg",
  stmach=0.6,
  tsmach=1.4,
  save=false,
  stype=4,
  trim=false,
  damp=true,
  build=1,
  part=true,
  highsym=false,
  highasy=true,
  highcon=false,
  tjet=false,
  hypeff=false,
  lb=false,
  pwr=false,
  grnd=false,
  wsspn=2.79,
  hsspn=1,
  ndelta=9,
  delta=[],
  deltal=[-32 -20 -10 -5 0 5 10 20 32],
  deltar=[32 20 10 5 0 -5 -10 -20 -32],
  ngh=0,
  grndht=[],
  config=struct(downwash=false, body=true, wing=true, htail=false, vtail=false, vfin=false),
  version=1976,
  cd=reshape([0.051 0.017 0.014 0.013 0.014 0.016 0.021 0.028 0.05 0.057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], 20, 2, 3),
  cl=reshape([-0.779 -0.254 -0.131 -0.015 0.101 0.223 0.352 0.486 0.765 0.835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], 20, 2, 3),
  cm=reshape([-0.1759 -0.0809 -0.0606 -0.0418 -0.0238 -0.0053 0.0135 0.0326 0.0709 0.0805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], 20, 2, 3),
  cn=reshape([-0.763 -0.254 -0.132 -0.016 0.1 0.223 0.353 0.487 0.764 0.834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], 20, 2, 3),
  ca=reshape([-0.165 -0.018 0.001 0.012 0.017 0.016 0.009 -0.006 -0.057 -0.074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], 20, 2, 3),
  xcp=reshape([0.231 0.319 0.459 2.692 -0.238 -0.024 0.038 0.067 0.093 0.096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], 20, 2, 3),
  cma=reshape([0.01323 0.01051 0.00978 0.009201 0.009122 0.009326 0.009475 0.009553 0.009567 0.009541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], 20, 2, 3),
  cyb=reshape([0 99999 99999 99999 99999 99999 99999 99999 99999 99999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], 20, 2, 3),
  cnb=reshape([-Inf 99999 99999 99999 99999 99999 99999 99999 99999 99999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], 20, 2, 3),
  clb=reshape([0.0007507 0.0001354 -8.121e-6 -0.0001448 -0.00028 -0.0004236 -0.0005746 -0.0007315 -0.001058 -0.001141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], 20, 2, 3),
  cla=reshape([0.06916 0.06213 0.05978 0.05802 0.05951 0.06285 0.06569 0.06785 0.07065 0.07101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], 20, 2, 3),
  clq=reshape([0.004413 99999 99999 99999 99999 99999 99999 99999 99999 99999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], 20, 2, 3),
  cmq=reshape([-0.002706 99999 99999 99999 99999 99999 99999 99999 99999 99999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], 20, 2, 3),
  clad=reshape([NaN 99999 99999 99999 99999 99999 99999 99999 99999 99999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], 20, 2, 3),
  cmad=reshape([NaN 99999 99999 99999 99999 99999 99999 99999 99999 99999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], 20, 2, 3),
  clp=reshape([-7.375e-5 -3.182e-5 -2.805e-5 -2.663e-5 -2.749e-5 -3.076e-5 -3.662e-5 -4.535e-5 -7.216e-5 -8.086e-5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], 20, 2, 3),
  cyp=reshape([-0.0008371 -0.0002744 -0.0001426 -1.6e-5 0.0001109 0.0002482 0.0003968 0.0005587 0.0009476 0.001072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], 20, 2, 3),
  cnp=reshape([0.001284 0.000421 0.0002188 2.455e-5 -0.0001702 -0.0003808 -0.0006087 -0.0008568 -0.001452 -0.001643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], 20, 2, 3),
  cnr=reshape([-0.0003189 -8.144e-5 -6.078e-5 -5.333e-5 -5.768e-5 -7.508e-5 -0.0001076 -0.0001567 -0.0003092 -0.0003589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], 20, 2, 3),
  clr=reshape([-0.003348 -0.001091 -0.0005643 -6.297e-5 0.0004333 0.0009603 0.001514 0.00209 0.003287 0.003592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], 20, 2, 3),
  wetarea_b=repmat(1.921, 2, 3),
  xcg_b=repmat(1.22, 2, 3),
  zcg_b=repmat(0.11, 2, 3),
  basearea_b=repmat(0.033, 2, 3),
  cd0_b=[0.001695 0.001696 0.001697; 0.001443 0.001443 0.001444],
  basedrag_b=[0.0002593 0.0002592 0.0002591; 0.0002893 0.0002893 0.0002892],
  fricdrag_b=[0.001436 0.001437 0.001438; 0.001153 0.001154 0.001155],
  presdrag_b=repmat(NaN, 2, 3),
  lemac=repmat(0.37, 2, 3),
  area_w_tt=repmat(4.839, 2, 3),
  taperratio_w_tt=repmat(1, 2, 3),
  aspectratio_w_tt=repmat(7.193, 2, 3),
  qcsweep_w_tt=repmat(0, 2, 3),
  mac_w_tt=repmat(0.82, 2, 3),
  qcmac_w_tt=repmat(1.06, 2, 3),
  ymac_w_tt=repmat(1.48, 2, 3),
  cd0_w_tt=repmat(99999, 2, 3),
  friccoeff_w_tt=repmat(99999, 2, 3),
  area_w_te=repmat(4.577, 2, 3),
  taperratio_w_te=repmat(1, 2, 3),
  aspectratio_w_te=repmat(6.803, 2, 3),
  qcsweep_w_te=repmat(0, 2, 3),
  mac_w_te=repmat(0.82, 2, 3),
  qcmac_w_te=repmat(1.06, 2, 3),
  ymac_w_te=repmat(1.56, 2, 3),
  cd0_w_te=[0.0104 0.0104 0.0104; 0.00826 0.00826 0.00827],
  friccoeff_w_te=[0.0062 0.0062 0.0062; 0.00492 0.00492 0.00492],
  cla_b_w=[0.003566 0.003566 0.003566; 0.003573 0.003573 0.003573],
  cla_w_b=[0.05277 0.05277 0.05277; 0.05288 0.05288 0.05288],
  k_b_w=repmat(0.07051, 2, 3),
  k_w_b=repmat(1.043, 2, 3),
  xacc_b_w=repmat(0.1783, 2, 3),
  hiv_b_w=repmat(99999, 20, 2, 3),
  hiv_w_h=repmat(99999, 20, 2, 3),
  hiv_b_h=repmat(99999, 20, 2, 3),
  gamma=reshape([NaN NaN NaN 0 0 0 0 0 NaN NaN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], 20, 2, 3),
  gamma2pialpvr=repmat(NaN, 20, 2, 3),
  iv_b_w=repmat(0, 20, 2, 3),
  iv_w_h=repmat(NaN, 20, 2, 3),
  iv_b_h=repmat(NaN, 20, 2, 3),
  clpgammacl0=[-0.46082 -0.46082 -0.46082; -0.46153 -0.46153 -0.46153],
  clpgammaclp=repmat(1, 2, 3),
  cnptheta=repmat(-0.00027961, 2, 3),
  cypgamma=repmat(0, 2, 3),
  cypcl=[0.069765 0.069765 0.069765; 0.06969 0.06969 0.06969],
  clbgamma=repmat(-0.0002375, 2, 3),
  cmothetaw=repmat(NaN, 2, 3),
  cmothetah=repmat(NaN, 2, 3),
  clroll=reshape([-0.056343 -0.047146 -0.030463 -0.015232 0 0.015232 0.030463 0.047146 0.056343 -0.056585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], 9, 2, 3),
  cn_asy=reshape([-0.007991 -0.002604 -0.001347 -0.0001503 0.001034 0.002292 0.003613 0.004988 0.007844 0.008572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], 20, 9, 2, 3)), struct(
  case="TOTAL: TOTAL: UAV",
  mach=[0.03 0.1],
  alt=[50 100 300],
  alpha=[-16 -8 -6 -4 -2 0 2 4 8 9 10 12 14 16 18 19 20 21 22 24],
  nmach=2,
  nalt=3,
  nalpha=20,
  rnnub=[],
  hypers=false,
  loop=2,
  sref=6.79,
  cbar=1.15,
  blref=5.9,
  dim="ft",
  deriv="deg",
  stmach=0.6,
  tsmach=1.4,
  save=false,
  stype=[],
  trim=false,
  damp=true,
  build=1,
  part=true,
  highsym=true,
  highasy=false,
  highcon=false,
  tjet=false,
  hypeff=false,
  lb=false,
  pwr=false,
  grnd=false,
  wsspn=2.79,
  hsspn=0.66,
  ndelta=8,
  delta=[-15 -10 -5 0 5 10 13 16],
  deltal=[],
  deltar=[],
  ngh=0,
  grndht=[],
  config=struct(downwash=true, body=true, wing=true, htail=true, vtail=true, vfin=false),
  version=1976,
  cd=reshape([0.067 0.023 0.019 0.016 0.016 0.018 0.023 0.03 0.054 0.062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], 20, 2, 3),
  cl=reshape([-0.828 -0.284 -0.156 -0.033 0.089 0.216 0.349 0.488 0.777 0.851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], 20, 2, 3),
  cm=reshape([-0.0614 -0.0118 -0.0044 0.0003 0.0038 0.0108 0.0195 0.0273 0.0423 0.046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], 20, 2, 3),
  cn=reshape([-0.814 -0.285 -0.157 -0.034 0.088 0.216 0.35 0.489 0.777 0.85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], 20, 2, 3),
  ca=reshape([-0.163 -0.016 0.002 0.014 0.019 0.018 0.011 -0.004 -0.055 -0.072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], 20, 2, 3),
  xcp=reshape([0.075 0.041 0.028 -0.008 0.043 0.05 0.056 0.056 0.054 0.054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], 20, 2, 3),
  cma=reshape([0.01072 0.004196 0.003017 0.002047 0.002636 0.003928 0.004125 0.003852 0.003709 0.003535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], 20, 2, 3),
  cyb=reshape([-0.001183 -0.001183 -0.001183 -0.001183 -0.001183 -0.001183 -0.001183 -0.001183 -0.001183 -0.001183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], 20, 2, 3),
  cnb=repmat(0.07, 20, 2, 3),
  clb=reshape([0.0006016 2.612e-5 -0.0001085 -0.000236 -0.0003617 -0.0004954 -0.0006363 -0.0007835 -0.001091 -0.001169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], 20, 2, 3),
  cla=reshape([0.07094 0.06482 0.06272 0.06116 0.06237 0.06523 0.06805 0.07036 0.07319 0.0736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], 20, 2, 3),
  qqinf=reshape([1 1 1 0.984 0.919 0.899 0.95 0.998 1 1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], 20, 2, 3),
  eps=reshape([-5.315 -1.852 -0.973 -0.112 0.76 1.679 2.596 3.524 5.382 5.85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], 20, 2, 3),
  depsdalp=reshape([0.433 0.438 0.435 0.433 0.448 0.459 0.461 0.464 0.467 0.453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], 20, 2, 3),
  clq=reshape([0.01852 0.01852 0.01852 0.01852 0.01852 0.01852 0.01852 0.01852 0.01852 0.01852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], 20, 2, 3),
  cmq=reshape([-0.03434 -0.03434 -0.03434 -0.03434 -0.03434 -0.03434 -0.03434 -0.03434 -0.03434 -0.03434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], 20, 2, 3),
  clad=reshape([0.006108 0.00618 0.006135 0.006016 0.005807 0.005822 0.006181 0.006532 0.006593 0.006393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], 20, 2, 3),
  cmad=reshape([-0.0137 -0.01386 -0.01376 -0.01349 -0.01302 -0.01305 -0.01386 -0.01464 -0.01478 -0.01433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], 20, 2, 3),
  clp=reshape([-0.0001218 -5.646e-5 -4.809e-5 -4.226e-5 -3.946e-5 -4.011e-5 -4.467e-5 -5.317e-5 -8.204e-5 -9.178e-5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], 20, 2, 3),
  cyp=reshape([-0.001087 -0.0004018 -0.0002385 -8.018e-5 7.871e-5 0.0002482 0.0004292 0.0006236 0.001078 0.001219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], 20, 2, 3),
  cnp=reshape([0.001373 0.0004692 0.0002555 4.93e-5 -0.0001576 -0.0003808 -0.0006214 -0.0008824 -0.001503 -0.0017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], 20, 2, 3),
  cnr=reshape([-0.0006239 -0.0004207 -0.0004068 -0.0004053 -0.0004149 -0.0004366 -0.0004726 -0.0005243 -0.0006794 -0.0007291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], 20, 2, 3),
  clr=reshape([-0.003207 -0.0009884 -0.0004728 1.714e-5 0.0005016 0.001016 0.001558 0.002121 0.003292 0.00359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], 20, 2, 3),
  wetarea_b=repmat(1.921, 2, 3),
  xcg_b=repmat(1.22, 2, 3),
  zcg_b=repmat(0.11, 2, 3),
  basearea_b=repmat(0.033, 2, 3),
  cd0_b=[0.001695 0.001696 0.001697; 0.001443 0.001443 0.001444],
  basedrag_b=[0.0002593 0.0002592 0.0002591; 0.0002893 0.0002893 0.0002892],
  fricdrag_b=[0.001436 0.001437 0.001438; 0.001153 0.001154 0.001155],
  presdrag_b=repmat(NaN, 2, 3),
  lemac=repmat(0.37, 2, 3),
  area_w_tt=repmat(4.839, 2, 3),
  taperratio_w_tt=repmat(1, 2, 3),
  aspectratio_w_tt=repmat(7.193, 2, 3),
  qcsweep_w_tt=repmat(0, 2, 3),
  mac_w_tt=repmat(0.82, 2, 3),
  qcmac_w_tt=repmat(1.06, 2, 3),
  ymac_w_tt=repmat(1.48, 2, 3),
  cd0_w_tt=repmat(99999, 2, 3),
  friccoeff_w_tt=repmat(99999, 2, 3),
  area_w_te=repmat(4.577, 2, 3),
  taperratio_w_te=repmat(1, 2, 3),
  aspectratio_w_te=repmat(6.803, 2, 3),
  qcsweep_w_te=repmat(0, 2, 3),
  mac_w_te=repmat(0.82, 2, 3),
  qcmac_w_te=repmat(1.06, 2, 3),
  ymac_w_te=repmat(1.56, 2, 3),
  cd0_w_te=[0.0104 0.0104 0.0104; 0.00826 0.00826 0.00827],
  friccoeff_w_te=[0.0062 0.0062 0.0062; 0.00492 0.00492 0.00492],
  area_ht_tt=repmat(0.5412, 2, 3),
  taperratio_ht_tt=repmat(0.608, 2, 3),
  aspectratio_ht_tt=repmat(3.22, 2, 3),
  qcsweep_ht_tt=repmat(11, 2, 3),
  mac_ht_tt=repmat(0.418, 2, 3),
  qcmac_ht_tt=repmat(3.8, 2, 3),
  ymac_ht_tt=repmat(0.303, 2, 3),
  cd0_ht_tt=repmat(99999, 2, 3),
  friccoeff_ht_tt=repmat(99999, 2, 3),
  area_ht_te=repmat(0.5412, 2, 3),
  taperratio_ht_te=repmat(0.608, 2, 3),
  aspectratio_ht_te=repmat(3.22, 2, 3),
  qcsweep_ht_te=repmat(11, 2, 3),
  mac_ht_te=repmat(0.418, 2, 3),
  qcmac_ht_te=repmat(3.8, 2, 3),
  ymac_ht_te=repmat(0.303, 2, 3),
  cd0_ht_te=[0.00129 0.00129 0.00129; 0.00102 0.00102 0.00102],
  friccoeff_ht_te=[0.00704 0.00705 0.00705; 0.00559 0.00559 0.00559],
  area_vt_tt=repmat(0.3312, 2, 3),
  taperratio_vt_tt=repmat(0.394, 2, 3),
  aspectratio_vt_tt=repmat(1.565, 2, 3),
  qcsweep_vt_tt=repmat(23, 2, 3),
  mac_vt_tt=repmat(0.489, 2, 3),
  qcmac_vt_tt=repmat(3.53, 2, 3),
  ymac_vt_tt=repmat(0.468, 2, 3),
  cd0_vt_tt=repmat(99999, 2, 3),
  friccoeff_vt_tt=repmat(99999, 2, 3),
  area_vt_te=repmat(0.3312, 2, 3),
  taperratio_vt_te=repmat(0.394, 2, 3),
  aspectratio_vt_te=repmat(1.565, 2, 3),
  qcsweep_vt_te=repmat(23, 2, 3),
  mac_vt_te=repmat(0.489, 2, 3),
  qcmac_vt_te=repmat(3.53, 2, 3),
  ymac_vt_te=repmat(0.308, 2, 3),
  cd0_vt_te=[0.000759 0.000759 0.00076; 0.000602 0.000602 0.000603],
  friccoeff_vt_te=[0.00684 0.00684 0.00685; 0.00542 0.00542 0.00543],
  cla_b_w=[0.003566 0.003566 0.003566; 0.003573 0.003573 0.003573],
  cla_w_b=[0.05277 0.05277 0.05277; 0.05288 0.05288 0.05288],
  k_b_w=repmat(0.07051, 2, 3),
  k_w_b=repmat(1.043, 2, 3),
  xacc_b_w=repmat(0.1783, 2, 3),
  cla_b_h=repmat(0, 2, 3),
  cla_h_b=[0.003147 0.003147 0.003147; 0.003138 0.003138 0.003138],
  k_b_h=repmat(0, 2, 3),
  k_h_b=repmat(1, 2, 3),
  xacc_b_h=repmat(0.1102, 2, 3),
  sidewash=repmat(0.61140424, 2, 3),
  hiv_b_w=repmat(99999, 20, 2, 3),
  hiv_w_h=repmat(99999, 20, 2, 3),
  hiv_b_h=repmat(99999, 20, 2, 3),
  gamma=reshape([NaN NaN NaN 0 0 0 0 0 NaN NaN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], 20, 2, 3),
  gamma2pialpvr=reshape([1.084 0.4918 0.406 0 0 0 0 0 0.4918 0.5661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], 20, 2, 3),
  iv_b_w=repmat(0, 20, 2, 3),
  iv_w_h=repmat(NaN, 20, 2, 3),
  iv_b_h=reshape([-0.2595 -0.08325 -0.003164 0 0 0 0 0 -0.08325 -0.1385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], 20, 2, 3),
  clpgammacl0=[-0.46082 -0.46082 -0.46082; -0.46153 -0.46153 -0.46153],
  clpgammaclp=repmat(1, 2, 3),
  cnptheta=repmat(-0.00027961, 2, 3),
  cypgamma=repmat(0, 2, 3),
  cypcl=[0.069765 0.069765 0.069765; 0.06969 0.06969 0.06969],
  clbgamma=repmat(-0.0002375, 2, 3),
  cmothetaw=repmat(NaN, 2, 3),
  cmothetah=repmat(NaN, 2, 3),
  dcl_sym=reshape([-0.025 -0.017 -0.009 0 0.009 0.017 0.022 0.027 -0.027 -0.018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], 8, 2, 3),
  dcm_sym=reshape([0.0588 0.0402 0.0201 0 -0.0201 -0.0402 -0.0517 -0.062 0.0616 0.0422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], 8, 2, 3),
  dclmax_sym=reshape([0.03 0.021 0.011 0 0.011 0.021 0.026 0.031 0.03 0.021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], 8, 2, 3),
  dcdmin_sym=reshape([0.00115 0.00046 0.00023 0 0.00023 0.00046 0.00088 0.00131 0.00115 0.00046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], 8, 2, 3),
  clad_sym=repmat(NaN, 8, 2, 3),
  cha_sym=reshape([-0.002178 99999 99999 99999 99999 99999 99999 99999 -0.002342 99999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], 8, 2, 3),
  chd_sym=reshape([-0.006294 -0.006248 -0.006248 -0.006248 -0.006248 -0.006248 -0.006265 -0.006317 -0.006177 -0.006127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], 8, 2, 3),
  dcdi_sym=reshape([0.00399 0.00229 0.00187 0.00144 0.00102 0.000613 0.000208 -0.000194 -0.000997 -0.0012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], 20, 8, 2, 3))}

SecArd = 0
Variant = Simulink.Variant()

Sim_Mode = Simulink.VariantConfigurationData(
  VariantConfigurations=[struct(
    Name="No_Secondary_HIL",
    Description="",
    ControlVariables=[struct(Name="SimType", Value="1", Source="data.sldd"), struct(Name="SecArd", Value="0", Source="data.sldd")],
    SubModelConfigurations=[]), struct(
    Name="With_Secondary_HIL",
    Description="",
    ControlVariables=[struct(Name="SimType", Value="1", Source="data.sldd"), struct(Name="SecArd", Value="1", Source="data.sldd")],
    SubModelConfigurations=[]), struct(
    Name="MIL",
    Description="",
    ControlVariables=[struct(Name="SimType", Value="0", Source="data.sldd"), struct(Name="SecArd", Value="0", Source="data.sldd")],
    SubModelConfigurations=[])],
  DefaultConfigurationName="MIL")

loggingSampleTime = Simulink.Parameter(1)